% Simulink data dictionary ModelDictionary.sldd

UserMISOs = Simulink.Bus()
  UserMISO_LHFE: double
  UserMISO_LKFE: double
  UserMISO_RHFE: double
  UserMISO_RKFE: double

Sig = Simulink.Signal()

Controlwords = Simulink.Bus()
  Controlword_LHFE: double
  Controlword_LKFE: double
  Controlword_RHFE: double
  Controlword_RKFE: double

ErrorSOMANETs = Simulink.Bus()
  ErrorSOMANET_LHFE: double
  ErrorSOMANET_LKFE: double
  ErrorSOMANET_RHFE: double
  ErrorSOMANET_RKFE: double

Statuswords = Simulink.Bus()
  Statusword_LHFE: double
  Statusword_LKFE: double
  Statusword_RHFE: double
  Statusword_RKFE: double

TimeStampSOMANETs = Simulink.Bus()
  TimeStampSOMANET_LHFE: double
  TimeStampSOMANET_LKFE: double
  TimeStampSOMANET_RHFE: double
  TimeStampSOMANET_RKFE: double

TuningCommands = Simulink.Bus()
  TuningCommand_LHFE: double
  TuningCommand_LKFE: double
  TuningCommand_RHFE: double
  TuningCommand_RKFE: double

TuningStatuses = Simulink.Bus()
  TuningStatus_LHFE: double
  TuningStatus_LKFE: double
  TuningStatus_RHFE: double
  TuningStatus_RKFE: double

UserMOSIs = Simulink.Bus()
  UserMOSI_LHFE: double
  UserMOSI_LKFE: double
  UserMOSI_RHFE: double
  UserMOSI_RKFE: double

DesiredOpModes = Simulink.Bus()
  DesiredOpMode_LHFE: double
  DesiredOpMode_LKFE: double
  DesiredOpMode_RHFE: double
  DesiredOpMode_RKFE: double

ConfigSOMANETs = Simulink.Bus()
  ConfigSOMANET_LHFE: Bus: ConfigSOMANET
  ConfigSOMANET_LKFE: Bus: ConfigSOMANET
  ConfigSOMANET_RHFE: Bus: ConfigSOMANET
  ConfigSOMANET_RKFE: Bus: ConfigSOMANET

actualAngles = Simulink.Bus()
  actualAngle_LHFE: double
  actualAngle_LKFE: double
  actualAngle_RHFE: double
  actualAngle_RKFE: double

actualDynamics = Simulink.Bus()
  actualAngles: Bus: actualAngles
  actualVelocities: Bus: actualVelocities
  actualTorques: Bus: actualTorques

actualTorques = Simulink.Bus()
  actualTorque_LHFE: double
  actualTorque_LKFE: double
  actualTorque_RHFE: double
  actualTorque_RKFE: double

actualVelocities = Simulink.Bus()
  actualVelocity_LHFE: double
  actualVelocity_LKFE: double
  actualVelocity_RHFE: double
  actualVelocity_RKFE: double

calculatedAngles = Simulink.Bus()
  calculatedAngle_LHFE: double
  calculatedAngle_LKFE: double
  calculatedAngle_RHFE: double
  calculatedAngle_RKFE: double

calculatedDynamics = Simulink.Bus()
  calculatedAngles: Bus: calculatedAngles
  calculatedVelocities: Bus: calculatedVelocities
  calculatedTorques: Bus: calculatedTorques

calculatedTorques = Simulink.Bus()
  calculatedTorque_LHFE: double
  calculatedTorque_LKFE: double
  calculatedTorque_RHFE: double
  calculatedTorque_RKFE: double

calculatedVelocities = Simulink.Bus()
  calculatedVelocity_LHFE: double
  calculatedVelocity_LKFE: double
  calculatedVelocity_RHFE: double
  calculatedVelocity_RKFE: double

targetAngles = Simulink.Bus()
  targetAngle_LHFE: double
  targetAngle_LKFE: double
  targetAngle_RHFE: double
  targetAngle_RKFE: double

targetTorques = Simulink.Bus()
  targetTorque_LHFE: double
  targetTorque_LKFE: double
  targetTorque_RHFE: double
  targetTorque_RKFE: double

targetVelocities = Simulink.Bus()
  targetVelocity_LHFE: double
  targetVelocity_LKFE: double
  targetVelocity_RHFE: double
  targetVelocity_RKFE: double

maxTorques = Simulink.Bus()
  maxTorque_LHFE: double
  maxTorque_LKFE: double
  maxTorque_RHFE: double
  maxTorque_RKFE: double

ConfigSOMANET = Simulink.Bus()
  AngleOffset: double
  PolePairs: double
  minPosLimit: double
  maxPosLimit: double
  maxSpeed: double
  maxTorque: double
  PositionKp: double
  PositionKi: double
  PositionKd: double
  PositionIntegralLimit: double
  VelocityKp: double
  VelocityKi: double
  VelocityKd: double
  VelocityIntegralLimit: double
  ErrorStatus: double
  BreakReleaseStrategy: double
  ErrorSensor: double
  ErrorMotionControl: double
  RatedTorque: double

statusBMS = Simulink.Bus()
  StateBMS: double
  StateChargeBattery: double
  TempBattery: double
  minVoltCell: double
  maxVoltCell: double

statusOpModeSOMANETs = Simulink.Bus()
  statusOpModeSOMANET_LHFE: double
  statusOpModeSOMANET_LKFE: double
  statusOpModeSOMANET_RHFE: double
  statusOpModeSOMANET_RKFE: double

statusPDB = Simulink.Bus()
  StatePDB: double
  CurrentBattery: double
  VoltageBattery: double
  TempDCDC: double

statusTemperatures = Simulink.Bus()
  TempSOMANET_LHFE: double
  TempSOMANET_LKFE: double
  TempSOMANET_RHFE: double
  TempSOMANET_RKFE: double
  TempMotor_LHFE: double
  TempMotor_LKFE: double
  TempMotor_RHFE: double
  TempMotor_RKFE: double

inSOMANET = Simulink.Bus()
  Statusword: double
  actualAngle: double
  actualVelocity: double
  actualTorque: double
  UserMISO: double
  TuningStatus: double
  ErrorSOMANET: double
  PhaseB_Current: double
  PhaseC_Current: double
  OpMode: double
  Temperature: double
  Timestamp: double

inDataSOMANETs = Simulink.Bus()
  inSOMANET_LHFE: Bus: inSOMANET
  inSOMANET_LKFE: Bus: inSOMANET
  inSOMANET_RHFE: Bus: inSOMANET
  inSOMANET_RKFE: Bus: inSOMANET

PhaseCurrents = Simulink.Bus()
  PhaseBC_Current_LHFE: Bus: PhaseBC_Current
  PhaseBC_Current_LKFE: Bus: PhaseBC_Current
  PhaseBC_Current_RHFE: Bus: PhaseBC_Current
  PhaseBC_Current_RKFE: Bus: PhaseBC_Current

PhaseBC_Current = Simulink.Bus()
  PhaseB_Current: double
  PhaseC_Current: double

toDataSOMANETs = Simulink.Bus()
  toSOMANET_LHFE: Bus: toSOMANET
  toSOMANET_LKFE: Bus: toSOMANET
  toSOMANET_RHFE: Bus: toSOMANET
  toSOMANET_RKFE: Bus: toSOMANET

toSOMANET = Simulink.Bus()
  Controlword: double
  OpMode: double
  targetAngle: double
  targetVelocity: double
  targetTorque: double
  TuningCommand: double
  UserMOSI: double
  maxTorque: double

toSafety = Simulink.Bus()
  ErrorSOMANET: double
  TempSOMANET: double
  TimestampSOMANET: double
  PhaseBC_Current: Bus: PhaseBC_Current

toSafetySOMANETs = Simulink.Bus()
  toSafety_LHFE: Bus: toSafety
  toSafety_LKFE: Bus: toSafety
  toSafety_RHFE: Bus: toSafety
  toSafety_RKFE: Bus: toSafety

targetDynamica = Simulink.Bus()
  targetAngle: double
  targetVelocity: double
  targetTorque: double

targetDynamics = Simulink.Bus()
  targetDynamica_LHFE: Bus: targetDynamica
  targetDynamica_LKFE: Bus: targetDynamica
  targetDynamica_RHFE: Bus: targetDynamica
  targetDynamica_RKFE: Bus: targetDynamica

actualDynamica = Simulink.Bus()
  actualAngle: double
  actualVelocity: double
  actualTorque: double

toInputDevice = Simulink.Bus()
  actualStateMARCH: double
  Error: double

toPDB = Simulink.Bus()
  MasterOP: double

toPowerElectronics = Simulink.Bus()
  toPDB: Bus: toPDB

toGES = Simulink.Bus()
  a: double

inGES = Simulink.Bus()
  TempMotor_LHFE: double
  TempMotor_LKFE: double
  TempMotor_RHFE: double
  TempMotor_RKFE: double

inInputDevice = Simulink.Bus()
  DesiredState: double
  Error: double

inPowerElectronics = Simulink.Bus()
  statusPDB: Bus: statusPDB
  statusBMS: Bus: statusBMS

Data = Simulink.Bus()
  inDataSOMANETs: Bus: inDataSOMANETs
  inInputDevice: Bus: inInputDevice
  inGES: Bus: inGES
  inPowerElectronics: Bus: inPowerElectronics
  toDataSOMANETs: Bus: toDataSOMANETs
  toInputDevice: Bus: toInputDevice
  toPowerElectronics: Bus: toPowerElectronics
  toGES: Bus: toGES
  Error: Bus: Error
  GaitPhase: double
  actualStateMARCH: double
  ConfigSOMANETs: double
  calculatedDynamics: Bus: calculatedDynamics

Error = Simulink.Bus()
  ErrorSOMANETs: Bus: ErrorSOMANETs
  ErrorInputDevice: double
  ErrorGES: Bus: ErrorGES
  ErrorPowerElectronics: Bus: ErrorPowerElectronics

ErrorGES = Simulink.Bus()
  Error_GES1: double
  Error_GES2: double

ErrorPowerElectronics = Simulink.Bus()
  ErrorBMS: double
  ErrorPDB: double